# Grasshopper definition ToolKit_with_patterning.gh (Grasshopper 1.0.7)
# plug-ins: Human UI, Telepathy, Heteroptera, MetaHopper, BitmapPlus, Pufferfish, Human, LunchBox, Pancake

# ----
# Hexagonal Radius Slider
mm_radius_r = Slider(3, range=1..3)
create_slider = CreateSlider(Slider=mm_radius_r, ShowBounds=False, ShowTicks=False, ShowTooltip=False, ShowValLabel=True, showLabel=True)
create_simple_grid = CreateSimpleGrid(UIElements=create_slider, RowDefinitions="Auto", ColumnDefinitions="Auto")
value_listener = ValueListener(Elements=create_slider, SomeProperty=True)  # -> Values, Indices
adjust_element_positioning = AdjustElementPositioning(
    ElementsToAdjust=create_slider,
    Margin="230,-52,0,20",
    AbsolutePositioning=False,
    Width=Slider(260, range=0..1000),
    HorizontalAlignment=0)
hex_radius_slider = RemoteSender(value_listener.Values)

# ----
# Hexagonal Shapes Gap
distance_d = Slider(1, range=0.5..1.9)
create_slider_2 = CreateSlider(Slider=distance_d, ShowBounds=False, ShowTicks=False, ShowTooltip=False, ShowValLabel=True, showLabel=True)
adjust_element_positioning_2 = AdjustElementPositioning(
    ElementsToAdjust=create_slider_2,
    Margin="30,10,0,20",
    AbsolutePositioning=False,
    Width=Slider(220, range=0..1000),
    HorizontalAlignment=0)
value_listener_2 = ValueListener(Elements=create_slider_2, SomeProperty=True)  # -> Values, Indices
create_simple_grid_2 = CreateSimpleGrid(UIElements=create_slider_2, RowDefinitions="Auto", ColumnDefinitions="Auto")
hex_distance_slider = RemoteSender(value_listener_2.Values)

# ----
# Young's Modulus Label
hex_distance_slider_2 = RemoteReceiver(hex_distance_slider)
hex_radius_slider_2 = RemoteReceiver(hex_radius_slider)
ghpython_script = GhPythonScript(rp=hex_radius_slider_2, d=hex_distance_slider_2)  # -> out, e
# ---------- ghpython_script: Python ----------
rin = int(rp//1.0)-1
din = int(d//0.5)-1

E = [
  #0.5- 1. -1.5 - 1.9 d   
    [3.86, 1.62, 0.64], #rp 1.0-1.9
    [3.24, 1.25, 0.59], #rp 2.0-2.9
    [3.06, 1.26, 0.63]  #rp 3.0-3.9
]
print(d)
print(rp)
e = "mm      E = {:.2f} MPa".format(E[rin][din])
# ---------- end ghpython_script ----------
panel = Panel(ghpython_script.e)
create_label = CreateLabel(LabelText="Not Defined", LabelSize=12, Justification=0)
create_simple_grid_3 = CreateSimpleGrid(UIElements=create_label, RowDefinitions="Auto", ColumnDefinitions="Auto")
adjust_element_positioning_3 = AdjustElementPositioning(
    ElementsToAdjust=create_label,
    Margin="475,-52,0,20",
    AbsolutePositioning=False,
    Width=Slider(160, range=0..1000),
    HorizontalAlignment=0)
set_label_contents = SetLabelContents(LabelToModify=create_label, NewLabelContents=ghpython_script.e)

# ----
# Sliders for scaling and Thresholding
threshold_boundary = Slider(0.1, range=0..1)
scale_factor = Slider(0.1, range=0..1)
create_slider_3 = CreateSlider(Slider=scale_factor, ShowBounds=False, ShowTicks=False, ShowTooltip=False, ShowValLabel=True, showLabel=True)
create_slider_4 = CreateSlider(Slider=threshold_boundary, ShowBounds=False, ShowTicks=False, ShowTooltip=False, ShowValLabel=True, showLabel=True)
value_listener_3 = ValueListener(Elements=create_slider_4, SomeProperty=True)  # -> Values, Indices
value_listener_4 = ValueListener(Elements=create_slider_3, SomeProperty=True)  # -> Values, Indices
adjust_element_positioning_4 = AdjustElementPositioning(ElementsToAdjust=create_slider_3, Margin="10,20,0,0", AbsolutePositioning=False, Width="250")
adjust_element_positioning_5 = AdjustElementPositioning(ElementsToAdjust=create_slider_4, Margin="10,20,0,0", AbsolutePositioning=False, Width="300")
entwine = Entwine(Branch00=create_slider_4, Branch01=create_slider_3, FlattenInputs=True)
create_simple_grid_4 = CreateSimpleGrid(UIElements=entwine, RowDefinitions="Auto", ColumnDefinitions="Auto")
adjust_element_positioning_6 = AdjustElementPositioning(ElementsToAdjust=create_simple_grid_4, Margin="0,0,0,0", AbsolutePositioning=False)
imagescalingfactor = RemoteSender(value_listener_4.Values)
sliders = RemoteSender(create_simple_grid_4)
edgethreshold = RemoteSender(value_listener_3.Values)

# ----
# File Saving Script
file_path = FilePath("D:\Biyon\3_15 Image_Border\Outputs\Base.STL")
c_script = CSharpScript(file_directory=file_path)  # inputs geometries: tree of GeometryBase, file_directory: String, export: Boolean
# ---------- c_script: C# usings ----------
using System.IO;
# ---------- c_script: C# ----------
    if(export){

      var guids = new List<Guid>();

      for(int i = 0; i < geometries.BranchCount; i++){
        for(int n = 0; n < geometries.Branches[i].Count; n++){
          var geom = geometries.Branches[i][n];
          var guid = Rhino.RhinoDoc.ActiveDoc.Objects.Add(geom);
          guids.Add(guid);
        }
      }

      Rhino.RhinoDoc.ActiveDoc.Objects.Select(guids);

      string filepath = file_directory;
      string cmd = "_-Export " + "\"" + filepath + "\"" + " _Enter _Enter";

      Rhino.RhinoApp.RunScript(cmd, false);

      Rhino.RhinoDoc.ActiveDoc.Objects.Delete(guids, true);
    }
# ---------- end c_script ----------

trigger = Trigger(Interval=500, TimerInterval=500, Target=[title_background_color, colour_swatch])

# ----
# Settings For HumanUI Interface
colour_swatch = ColourSwatch(SwatchColor=RGB(154, 214, 130))
title_background_color = ColourSwatch(SwatchColor=RGB(33, 33, 33))
title_font_color = ColourSwatch(SwatchColor=RGB(255, 255, 255))
main_window_width = Slider(650, range=0..10000)
input_color = ColourSwatch(SwatchColor=RGB(0, 0, 0))
main_window_height = Slider(900, range=0..10000)
window_background_color = ColourSwatch(SwatchColor=RGB(45, 69, 61))
input_background_color = ColourSwatch(SwatchColor=RGB(255, 255, 255))
grid_background_color = ColourSwatch(SwatchColor=RGBA(242, 242, 242, 242))
scroll_view_color = ColourSwatch(SwatchColor=RGBA(255, 255, 255, 143))
title_font = Slider(20, range=0..100)
titlebgcolor = RemoteSender(title_background_color)
titlefont = RemoteSender(title_font)
winwidth = RemoteSender(main_window_width)
titlecolor = RemoteSender(title_font_color)
winheight = RemoteSender(main_window_height)
scrollcolor = RemoteSender(scroll_view_color)
inputcolor = RemoteSender(input_color)
winbgcolor = RemoteSender(window_background_color)
gridbgcolor = RemoteSender(grid_background_color)
seperatorclr = RemoteSender(ColourSwatch(SwatchColor=RGB(200, 200, 204)))
inputbgcolor = RemoteSender(input_background_color)
seperatorthickness = RemoteSender(Slider(1, range=0..10))

# ----
# Create Surfaces from the Contours
panel_2 = Panel("Create Surfaces")
create_button = CreateButton(ButtonName=panel_2, ButtonStyle=0)
adjust_element_appearance = AdjustElementAppearance(ElementsToAdjust=create_button, Background=ColourSwatch(SwatchColor=RGB(154, 214, 130)))
value_listener_5 = ValueListener(Elements=create_button, SomeProperty=True)  # -> Values, Indices
adjust_element_positioning_7 = AdjustElementPositioning(
    ElementsToAdjust=create_button,
    Margin="40,0,0,20",
    AbsolutePositioning=False,
    Width=Slider(505, range=0..1000),
    HorizontalAlignment=0)
set_button = SetButton(ButtonToModify=create_button)
panel_3 = Panel(value_listener_5.Values)
create_simple_grid_5 = CreateSimpleGrid(UIElements=create_button, RowDefinitions="Auto", ColumnDefinitions="Auto")
create_surfaces = RemoteSender(value_listener_5.Values)
gridbgcolor_2 = RemoteReceiver(gridbgcolor)
adjust_element_positioning_8 = AdjustElementPositioning(ElementsToAdjust=create_simple_grid_5, Margin="0,0,0,0", AbsolutePositioning=False)
adjust_element_appearance_2 = AdjustElementAppearance(ElementsToAdjust=create_simple_grid_5, Background=gridbgcolor_2)
createsurfacebutton = RemoteSender(create_simple_grid_5)

# ----
# Show Hide image preview
panel_4 = Panel("Preview Image")
create_toggle = CreateToggle(Default="True", OnLabel="Show", OffLabel="Hide")
create_label_2 = CreateLabel(LabelText=panel_4, LabelSize=12, Justification=0)
adjust_element_positioning_9 = AdjustElementPositioning(
    ElementsToAdjust=create_toggle,
    Margin="440,-15,0,20",
    AbsolutePositioning=True,
    HorizontalAlignment=0,
    VerticalAlignment=2)
value_listener_6 = ValueListener(Elements=create_toggle, SomeProperty=True)  # -> Values, Indices
set_label_contents_2 = SetLabelContents(LabelToModify=create_label_2, NewLabelContents=panel_4)
adjust_element_appearance_3 = AdjustElementAppearance(ElementsToAdjust=create_label_2, FontSize=Slider(12, range=0..100))
adjust_element_positioning_10 = AdjustElementPositioning(ElementsToAdjust=create_label_2, Margin="340,15,0,0", AbsolutePositioning=False, HorizontalAlignment=0)
panel_5 = Panel(value_listener_6.Values)
merge = Merge(Data1=create_toggle, Data2=create_label_2)
create_grid = CreateGrid(UIElements=merge, ElementRowSpan=1, ElementColumnSpan=1)
showimage = RemoteSender(value_listener_6.Values)
gridbgcolor_3 = RemoteReceiver(gridbgcolor)
adjust_element_appearance_4 = AdjustElementAppearance(ElementsToAdjust=create_grid, Background=gridbgcolor_3)
showimagebutton = RemoteSender(create_grid)
adjust_element_positioning_11 = AdjustElementPositioning(ElementsToAdjust=create_grid, Margin="0,0,0,0", AbsolutePositioning=False)

panel_6 = Panel("Tune Young's Modulus (E) of the Design")
create_label_3 = CreateLabel(LabelText=panel_6, LabelSize=12, Justification=0)
winwidth_2 = RemoteReceiver(winwidth)
set_label_contents_3 = SetLabelContents(LabelToModify=create_label_3, NewLabelContents=panel_6)
titlefont_2 = RemoteReceiver(titlefont)
titlecolor_2 = RemoteReceiver(titlecolor)
titlebgcolor_2 = RemoteReceiver(titlebgcolor)
adjust_element_appearance_5 = AdjustElementAppearance(ElementsToAdjust=create_label_3, Foreground=titlecolor_2, Background=titlebgcolor_2, FontSize=titlefont_2)
adjust_element_positioning_12 = AdjustElementPositioning(ElementsToAdjust=create_label_3, Margin="0,0,0,10", AbsolutePositioning=False, Width=winwidth_2)
hexagonal_pattern_label = RemoteSender(create_label_3)

# ----
# File Select Button
panel_7 = Panel("File Select")
create_file_picker = CreateFilePicker(ButtonLabelText=panel_7, DialogType=0, MustExist=True, Filter="All Files|*.*")
value_listener_7 = ValueListener(Elements=create_file_picker, SomeProperty=True)  # -> Values, Indices
ghpython_script_2 = GhPythonScript(x=value_listener_7.Values)  # -> out, a
# ---------- ghpython_script_2: Python ----------
if x=="":
    a=1
else:
    a=0
# ---------- end ghpython_script_2 ----------
create_grid_2 = CreateGrid(UIElements=create_file_picker, ElementRowSpan=1, ElementColumnSpan=1)
panel_8 = Panel(ghpython_script_2.a)
adjust_element_positioning_13 = AdjustElementPositioning(
    ElementsToAdjust=create_file_picker,
    Margin="-50,0,0,0",
    AbsolutePositioning=False,
    Width=Slider(570, range=0..1000),
    HorizontalAlignment=1)
gridbgcolor_4 = RemoteReceiver(gridbgcolor)
adjust_element_appearance_6 = AdjustElementAppearance(ElementsToAdjust=create_grid_2, Background=gridbgcolor_4)
fileselectbutton = RemoteSender(create_grid_2)
file_path_2 = RemoteSender(value_listener_7.Values)

panel_9 = Panel("Stretch Sensor Integration")
create_label_4 = CreateLabel(LabelText=panel_9, LabelSize=12, Justification=0)
winwidth_3 = RemoteReceiver(winwidth)
set_label_contents_4 = SetLabelContents(LabelToModify=create_label_4, NewLabelContents=panel_9)
titlefont_3 = RemoteReceiver(titlefont)
titlebgcolor_3 = RemoteReceiver(titlebgcolor)
titlecolor_3 = RemoteReceiver(titlecolor)
adjust_element_appearance_7 = AdjustElementAppearance(ElementsToAdjust=create_label_4, Foreground=titlecolor_3, Background=titlebgcolor_3, FontSize=titlefont_3)
adjust_element_positioning_14 = AdjustElementPositioning(ElementsToAdjust=create_label_4, Margin="0,0,0,10", AbsolutePositioning=False, Width=winwidth_3)
stretch_sensor_label = RemoteSender(create_label_4)

create_label_5 = CreateLabel(LabelText="Export Parts", LabelSize=12, Justification=0)
titlefont_4 = RemoteReceiver(titlefont)
winwidth_4 = RemoteReceiver(winwidth)
titlecolor_4 = RemoteReceiver(titlecolor)
titlebgcolor_4 = RemoteReceiver(titlebgcolor)
set_label_contents_5 = SetLabelContents(LabelToModify=create_label_5, NewLabelContents="Export Parts")
adjust_element_appearance_8 = AdjustElementAppearance(ElementsToAdjust=create_label_5, Foreground=titlecolor_4, Background=titlebgcolor_4, FontSize=titlefont_4)
adjust_element_positioning_15 = AdjustElementPositioning(ElementsToAdjust=create_label_5, Margin="0,0,0,15", AbsolutePositioning=False, Width=winwidth_4, HorizontalAlignment=0)
label_export = RemoteSender(create_label_5)

panel_10 = Panel("Conductive Boundary Selection")
create_label_6 = CreateLabel(LabelText=panel_10, LabelSize=12, Justification=0)
winwidth_5 = RemoteReceiver(winwidth)
set_label_contents_6 = SetLabelContents(LabelToModify=create_label_6, NewLabelContents=panel_10)
titlefont_5 = RemoteReceiver(titlefont)
titlecolor_5 = RemoteReceiver(titlecolor)
titlebgcolor_5 = RemoteReceiver(titlebgcolor)
adjust_element_appearance_9 = AdjustElementAppearance(ElementsToAdjust=create_label_6, Foreground=titlecolor_5, Background=titlebgcolor_5, FontSize=titlefont_5)
adjust_element_positioning_16 = AdjustElementPositioning(ElementsToAdjust=create_label_6, Margin="0,0,0,10", AbsolutePositioning=False, Width=winwidth_5)
stretch_sensor_label_2 = RemoteSender(create_label_6)

# ----
# Select Surface button
panel_11 = Panel("Select Surfaces")
create_button_2 = CreateButton(ButtonName=panel_11, ButtonStyle=0)
create_rhino_pick_button = CreateRhinoPickButton(ButtonName=panel_11, Prompt="Please select geometry...", AllowMultiple=True, AllowNone=True, Type=0, ButtonStyle=0)
adjust_element_appearance_10 = AdjustElementAppearance(ElementsToAdjust=create_rhino_pick_button, Background=ColourSwatch(SwatchColor=RGB(154, 214, 130)))
adjust_element_positioning_17 = AdjustElementPositioning(
    ElementsToAdjust=create_rhino_pick_button,
    Margin="40,10,0,20",
    AbsolutePositioning=False,
    Width=Slider(215, range=0..1000),
    HorizontalAlignment=0)
set_button_2 = SetButton(ButtonToModify=create_rhino_pick_button)
value_listener_8 = ValueListener(Elements=create_rhino_pick_button, SomeProperty=True)  # -> Values, Indices
create_simple_grid_6 = CreateSimpleGrid(UIElements=create_rhino_pick_button, RowDefinitions="Auto", ColumnDefinitions="Auto")
gridbgcolor_5 = RemoteReceiver(gridbgcolor)
surface_sel = RemoteSender(value_listener_8.Values)
panel_12 = Panel(value_listener_8.Values)
adjust_element_appearance_11 = AdjustElementAppearance(ElementsToAdjust=create_simple_grid_6, Background=gridbgcolor_5)
selsuf = RemoteSender(create_simple_grid_6)
adjust_element_positioning_18 = AdjustElementPositioning(ElementsToAdjust=create_simple_grid_6, Margin="0,15,0,0", AbsolutePositioning=False)

# ----
# Reset filements
panel_13 = Panel("Reset")
create_button_3 = CreateButton(ButtonName=panel_13, ButtonStyle=0)
adjust_element_appearance_12 = AdjustElementAppearance(ElementsToAdjust=create_button_3, Background=ColourSwatch(SwatchColor=RGB(154, 214, 130)))
value_listener_9 = ValueListener(Elements=create_button_3, SomeProperty=True)  # -> Values, Indices
adjust_element_positioning_19 = AdjustElementPositioning(
    ElementsToAdjust=create_button_3,
    Margin="0,0,0,20",
    AbsolutePositioning=False,
    Width=Slider(215, range=0..1000),
    HorizontalAlignment=0)
set_button_3 = SetButton(ButtonToModify=create_button_3)
create_simple_grid_7 = CreateSimpleGrid(UIElements=create_button_3, RowDefinitions="Auto", ColumnDefinitions="Auto")
panel_14 = Panel(value_listener_9.Values)
gridbgcolor_6 = RemoteReceiver(gridbgcolor)
reset = RemoteSender(value_listener_9.Values)
adjust_element_positioning_20 = AdjustElementPositioning(ElementsToAdjust=create_simple_grid_7, Margin="330,-50,0,0", AbsolutePositioning=False)
adjust_element_appearance_13 = AdjustElementAppearance(ElementsToAdjust=create_simple_grid_7, Background=gridbgcolor_6)
reset_2 = RemoteSender(create_simple_grid_7)

create_label_7 = CreateLabel(LabelText="Filament Selection", LabelSize=12, Justification=0)
winwidth_6 = RemoteReceiver(winwidth)
set_label_contents_7 = SetLabelContents(LabelToModify=create_label_7, NewLabelContents="Filament Selection")
titlefont_6 = RemoteReceiver(titlefont)
titlecolor_6 = RemoteReceiver(titlecolor)
titlebgcolor_6 = RemoteReceiver(titlebgcolor)
adjust_element_appearance_14 = AdjustElementAppearance(ElementsToAdjust=create_label_7, Foreground=titlecolor_6, Background=titlebgcolor_6, FontSize=titlefont_6)
adjust_element_positioning_21 = AdjustElementPositioning(ElementsToAdjust=create_label_7, Margin="0,0,0,10", AbsolutePositioning=False, Width=winwidth_6)
label_rough = RemoteSender(create_label_7)

# ----
# Title(Model selection)
panel_15 = Panel("Image Selection and Preview")
create_label_8 = CreateLabel(LabelText=panel_15, LabelSize=12, Justification=0)
set_label_contents_8 = SetLabelContents(LabelToModify=create_label_8, NewLabelContents=panel_15)
titlebgcolor_7 = RemoteReceiver(titlebgcolor)
titlecolor_7 = RemoteReceiver(titlecolor)
titlefont_7 = RemoteReceiver(titlefont)
label_adaptortitle = RemoteSender(create_label_8)
winwidth_7 = RemoteReceiver(winwidth)
adjust_element_positioning_22 = AdjustElementPositioning(ElementsToAdjust=create_label_8, Margin="0,0,0,10", AbsolutePositioning=False, Width=winwidth_7)
adjust_element_appearance_15 = AdjustElementAppearance(ElementsToAdjust=create_label_8, Foreground=titlecolor_7, Background=titlebgcolor_7, FontSize=titlefont_7)

# ----
# 3_Tune Young's Modulus (E) for Hex Pattern
createsurfacebutton_2 = RemoteReceiver(createsurfacebutton)
entwine_2 = Entwine(
    Branch00=hexagonal_pattern_label,
    Branch01=create_simple_grid_2,
    Branch02=create_simple_grid,
    Branch03=create_simple_grid_3,
    Branch04=createsurfacebutton_2,
    FlattenInputs=True)
winwidth_8 = RemoteReceiver(winwidth)
create_simple_grid_8 = CreateSimpleGrid(UIElements=flatten(entwine_2), Width=winwidth_8, RowDefinitions="Auto", ColumnDefinitions="Auto")
gridbgcolor_7 = RemoteReceiver(gridbgcolor)
adjust_element_positioning_23 = AdjustElementPositioning(ElementsToAdjust=create_simple_grid_8, Margin="0,10,0,0", AbsolutePositioning=False, HorizontalAlignment=1)
adjust_element_appearance_16 = AdjustElementAppearance(ElementsToAdjust=create_simple_grid_8, Background=gridbgcolor_7)
tabthree = RemoteSender(create_simple_grid_8)

# ----
# 1_Image Selection and Preview Tab
showimagebutton_2 = RemoteReceiver(showimagebutton)
fileselectbutton_2 = RemoteReceiver(fileselectbutton)
label_adaptortitle_2 = RemoteReceiver(label_adaptortitle)
sliders_2 = RemoteReceiver(sliders)
entwine_3 = Entwine(
    Branch00=label_adaptortitle_2,
    Branch01=fileselectbutton_2,
    Branch05=sliders_2,
    Branch06=showimagebutton_2,
    FlattenInputs=True)  # -> flatten(Result)
winwidth_9 = RemoteReceiver(winwidth)
create_simple_grid_9 = CreateSimpleGrid(UIElements=entwine_3, Width=winwidth_9, RowDefinitions="Auto", ColumnDefinitions="Auto")
gridbgcolor_8 = RemoteReceiver(gridbgcolor)
adjust_element_positioning_24 = AdjustElementPositioning(ElementsToAdjust=create_simple_grid_9, Margin="0,10,0,0", AbsolutePositioning=False, HorizontalAlignment=1)
adjust_element_appearance_17 = AdjustElementAppearance(ElementsToAdjust=create_simple_grid_9, Background=gridbgcolor_8)
tabone = RemoteSender(create_simple_grid_9)

buttonbgcolor = RemoteSender(colour_swatch)

# ---- group: Stretch Sensor Integration Surface Selection
# Surface Select Button
panel_16 = Panel("Select a Surface")
create_rhino_pick_button_2 = CreateRhinoPickButton(ButtonName=panel_16, Prompt="Please select geometry...", AllowMultiple=True, AllowNone=True, Type=0, ButtonStyle=0)
buttonbgcolor_2 = RemoteReceiver(buttonbgcolor)
adjust_element_appearance_18 = AdjustElementAppearance(ElementsToAdjust=create_rhino_pick_button_2, Background=buttonbgcolor_2)
adjust_element_positioning_25 = AdjustElementPositioning(
    ElementsToAdjust=create_rhino_pick_button_2,
    Margin="40,10,0,20",
    AbsolutePositioning=False,
    Width=Slider(150, range=0..1000),
    HorizontalAlignment=0)
value_listener_10 = ValueListener(Elements=create_rhino_pick_button_2, SomeProperty=True)  # -> Values, Indices
create_simple_grid_10 = CreateSimpleGrid(UIElements=create_rhino_pick_button_2, RowDefinitions="Auto", ColumnDefinitions="Auto")
gridbgcolor_9 = RemoteReceiver(gridbgcolor)
adjust_element_appearance_19 = AdjustElementAppearance(ElementsToAdjust=create_simple_grid_10, Background=gridbgcolor_9)
stretch_sensor_select_surface = RemoteSender(create_simple_grid_10)

# ----
# Point Selector
panel_17 = Panel("Select Set Points")
create_rhino_pick_button_3 = CreateRhinoPickButton(ButtonName=panel_17, Prompt="Please select geometry...", AllowMultiple=True, AllowNone=True, Type=0, ButtonStyle=0)
buttonbgcolor_3 = RemoteReceiver(buttonbgcolor)
value_listener_11 = ValueListener(Elements=create_rhino_pick_button_3, SomeProperty=True)  # -> Values, Indices
adjust_element_appearance_20 = AdjustElementAppearance(ElementsToAdjust=create_rhino_pick_button_3, Background=buttonbgcolor_3)
adjust_element_positioning_26 = AdjustElementPositioning(
    ElementsToAdjust=create_rhino_pick_button_3,
    Margin="0,0,0,20",
    AbsolutePositioning=False,
    Width=Slider(150, range=0..1000),
    HorizontalAlignment=0)
create_simple_grid_11 = CreateSimpleGrid(UIElements=create_rhino_pick_button_3, RowDefinitions="Auto", ColumnDefinitions="Auto")
gridbgcolor_10 = RemoteReceiver(gridbgcolor)
selectsetpoints = RemoteSender(value_listener_11.Values)
adjust_element_appearance_21 = AdjustElementAppearance(ElementsToAdjust=create_simple_grid_11, Background=gridbgcolor_10)
adjust_element_positioning_27 = AdjustElementPositioning(ElementsToAdjust=create_simple_grid_11, Margin="400,-49,0,0", AbsolutePositioning=False)

# ----
# Line Drawer Button
panel_18 = Panel("Draw the Sensor Line ")
create_rhino_command_button = CreateRhinoCommandButton(ButtonName=panel_18, RhinoScript=graft("line"), ButtonStyle=0)
buttonbgcolor_4 = RemoteReceiver(buttonbgcolor)
adjust_element_positioning_28 = AdjustElementPositioning(
    ElementsToAdjust=create_rhino_command_button,
    Margin="40,10,0,20",
    AbsolutePositioning=False,
    Width=Slider(215, range=0..1000),
    HorizontalAlignment=0)
value_listener_12 = ValueListener(Elements=create_rhino_command_button, SomeProperty=True)  # -> Values, Indices
adjust_element_appearance_22 = AdjustElementAppearance(ElementsToAdjust=create_rhino_command_button, Background=buttonbgcolor_4)
create_simple_grid_12 = CreateSimpleGrid(UIElements=create_rhino_command_button, RowDefinitions="Auto", ColumnDefinitions="Auto")
panel_19 = Panel(value_listener_12.Values)
gridbgcolor_11 = RemoteReceiver(gridbgcolor)
adjust_element_appearance_23 = AdjustElementAppearance(ElementsToAdjust=create_simple_grid_12, Background=gridbgcolor_11)
stretch_sensor_set_line = RemoteSender(create_simple_grid_12)
adjust_element_positioning_29 = AdjustElementPositioning(ElementsToAdjust=create_simple_grid_12, Margin="0,0,0,0", AbsolutePositioning=False)

# ----
# Line Select Button
panel_20 = Panel("Select the Sensor Line")
create_rhino_pick_button_4 = CreateRhinoPickButton(ButtonName=panel_20, Prompt="Please select geometry...", AllowMultiple=True, AllowNone=True, Type=0, ButtonStyle=0)
buttonbgcolor_5 = RemoteReceiver(buttonbgcolor)
value_listener_13 = ValueListener(Elements=create_rhino_pick_button_4, SomeProperty=True)  # -> Values, Indices
adjust_element_appearance_24 = AdjustElementAppearance(ElementsToAdjust=create_rhino_pick_button_4, Background=buttonbgcolor_5)
adjust_element_positioning_30 = AdjustElementPositioning(
    ElementsToAdjust=create_rhino_pick_button_4,
    Margin="330,-50,0,20",
    AbsolutePositioning=False,
    Width=Slider(215, range=0..1000),
    HorizontalAlignment=0)
create_simple_grid_13 = CreateSimpleGrid(UIElements=create_rhino_pick_button_4, RowDefinitions="Auto", ColumnDefinitions="Auto")
stretch_sensor_line = RemoteSender(value_listener_13.Values)
panel_21 = Panel(value_listener_13.Values)
gridbgcolor_12 = RemoteReceiver(gridbgcolor)
adjust_element_appearance_25 = AdjustElementAppearance(ElementsToAdjust=create_simple_grid_13, Background=gridbgcolor_12)
adjust_element_positioning_31 = AdjustElementPositioning(ElementsToAdjust=create_simple_grid_13, Margin="0,0,0,0", AbsolutePositioning=False)

# ----
# Generate STL Button
panel_22 = Panel("Generate STL")
create_button_4 = CreateButton(ButtonName=panel_22, ButtonStyle=0)
buttonbgcolor_6 = RemoteReceiver(buttonbgcolor)
adjust_element_appearance_26 = AdjustElementAppearance(ElementsToAdjust=create_button_4, Background=buttonbgcolor_6)
value_listener_14 = ValueListener(Elements=create_button_4, SomeProperty=True)  # -> Values, Indices
adjust_element_positioning_32 = AdjustElementPositioning(
    ElementsToAdjust=create_button_4,
    Margin="40,10,0,20",
    AbsolutePositioning=False,
    Width=Slider(543, range=0..1000),
    HorizontalAlignment=0)
set_button_4 = SetButton(ButtonToModify=create_button_4)
panel_23 = Panel(value_listener_14.Values)
create_simple_grid_14 = CreateSimpleGrid(UIElements=create_button_4, RowDefinitions="Auto", ColumnDefinitions="Auto")
gridbgcolor_13 = RemoteReceiver(gridbgcolor)
export = RemoteSender(value_listener_14.Values)
adjust_element_appearance_27 = AdjustElementAppearance(ElementsToAdjust=create_simple_grid_14, Background=gridbgcolor_13)
adjust_element_positioning_33 = AdjustElementPositioning(ElementsToAdjust=create_simple_grid_14, Margin="0,0,0,0", AbsolutePositioning=False)
exportselection1 = RemoteSender(create_simple_grid_14)

# ----
# 4_Stretch Sensor Integration
entwine_4 = Entwine(Branch00=stretch_sensor_label, Branch02=stretch_sensor_set_line, Branch03=create_simple_grid_13, FlattenInputs=True)
winwidth_10 = RemoteReceiver(winwidth)
gridbgcolor_14 = RemoteReceiver(gridbgcolor)
create_simple_grid_15 = CreateSimpleGrid(UIElements=flatten(entwine_4), Width=winwidth_10, RowDefinitions="Auto", ColumnDefinitions="Auto")
adjust_element_appearance_28 = AdjustElementAppearance(ElementsToAdjust=create_simple_grid_15, Background=gridbgcolor_14)
adjust_element_positioning_34 = AdjustElementPositioning(ElementsToAdjust=create_simple_grid_15, Margin="0,10,0,0", AbsolutePositioning=False, HorizontalAlignment=1)
tabfour = RemoteSender(create_simple_grid_15)

# ----
# 6_Export_Outputs
label_export_2 = RemoteReceiver(label_export)
exportselection1_2 = RemoteReceiver(exportselection1)
entwine_5 = Entwine(Branch00=label_export_2, Branch03=exportselection1_2, FlattenInputs=True)  # -> flatten(Result)
create_simple_grid_16 = CreateSimpleGrid(UIElements=entwine_5, RowDefinitions="Auto", ColumnDefinitions="Auto")
gridbgcolor_15 = RemoteReceiver(gridbgcolor)
winwidth_11 = RemoteReceiver(winwidth)
adjust_element_positioning_35 = AdjustElementPositioning(
    ElementsToAdjust=create_simple_grid_16,
    Margin="0,10,0,15",
    AbsolutePositioning=False,
    Width=winwidth_11,
    HorizontalAlignment=1)
adjust_element_appearance_29 = AdjustElementAppearance(ElementsToAdjust=create_simple_grid_16, Background=gridbgcolor_15)
tabsix = RemoteSender(create_simple_grid_16)

# ----
# Undo the Selection FIlter
command = Panel("_-SelectionFilter _ShowDialog=No _Curves=Yes _Surfaces=Yes _Points=Yes _Curves=Yes _Enter")
export_2 = RemoteReceiver(export)
rhino_command = RhinoCommand(SendCommandToggle=export_2, CommandString=command)

create_button_5 = CreateButton(ButtonName="Commit Changes", ButtonStyle=0)
create_text_box = CreateTextBox(Label="New Filament", UpdateButton=Toggle(False), showLabel=True)
value_listener_15 = ValueListener(Elements=create_button_5, SomeProperty=True)  # -> Values, Indices
adjust_element_appearance_30 = AdjustElementAppearance(ElementsToAdjust=create_button_5, Background=ColourSwatch(SwatchColor=RGB(154, 214, 130)))
filamentnamelabel = RemoteSender(create_text_box)
value_listener_16 = ValueListener(Elements=create_text_box, Trigger=value_listener_15.Values, SomeProperty=False)  # -> Values, Indices
panel_24 = Panel(value_listener_16.Values)
create_simple_grid_17 = CreateSimpleGrid(UIElements=create_button_5, RowDefinitions="Auto", ColumnDefinitions="Auto")
grid_background_color_2 = ColourSwatch(SwatchColor=RGB(255, 255, 255))
adjust_element_positioning_36 = AdjustElementPositioning(
    ElementsToAdjust=create_simple_grid_17,
    Margin="50,10,0,0",
    AbsolutePositioning=True,
    Width=Slider(241, range=0..1000),
    HorizontalAlignment=0)
adjust_element_appearance_31 = AdjustElementAppearance(ElementsToAdjust=create_simple_grid_17, Background=grid_background_color_2)
commitcommand = RemoteSender(value_listener_15.Values)
commitfilamentbutton = RemoteSender(create_simple_grid_17)
commitmessage = RemoteSender(value_listener_16.Values)

create_button_6 = CreateButton(ButtonName="Remove Last", ButtonStyle=0)
value_listener_17 = ValueListener(Elements=create_button_6, SomeProperty=True)  # -> Values, Indices
create_simple_grid_18 = CreateSimpleGrid(UIElements=create_button_6, RowDefinitions="Auto", ColumnDefinitions="Auto")
adjust_element_appearance_32 = AdjustElementAppearance(ElementsToAdjust=create_button_6, Background=ColourSwatch(SwatchColor=RGB(154, 214, 130)))
grid_background_color_3 = ColourSwatch(SwatchColor=RGB(255, 255, 255))
adjust_element_positioning_37 = AdjustElementPositioning(
    ElementsToAdjust=create_simple_grid_18,
    Margin="200,-37,0,0",
    AbsolutePositioning=True,
    Width=Slider(215, range=0..1000),
    HorizontalAlignment=0)
adjust_element_appearance_33 = AdjustElementAppearance(ElementsToAdjust=create_simple_grid_18, Background=grid_background_color_3)
removefilamentbutton = RemoteSender(create_simple_grid_18)
removelastfilament = RemoteSender(value_listener_17.Values)

# ----
# Stretch Sensor Generation
stretch_sensor_line_2 = RemoteReceiver(stretch_sensor_line)
offset_curve = OffsetCurve(Curve=stretch_sensor_line_2, Distance="3", Corners=1)
offset_curve_2 = OffsetCurve(Curve=stretch_sensor_line_2, Distance="-3", Corners=1)
end_points = EndPoints(Curve=offset_curve)  # -> Start, End
end_points_2 = EndPoints(Curve=offset_curve_2)  # -> Start, End
line = Line(StartPoint=end_points.End, EndPoint=end_points_2.End)
vector_2pt = Vector2Pt(PointA=end_points_2.Start, PointB=end_points.Start, Unitize=True)  # -> Vector, Length
vector_2pt_2 = Vector2Pt(PointA=end_points.Start, PointB=end_points_2.Start, Unitize=True)  # -> Vector, Length
multiplication = Multiplication(A=vector_2pt.Vector, B="3")
multiplication_2 = Multiplication(A=vector_2pt_2.Vector, B="3")
move = Move(Geometry=end_points_2.Start, Motion=multiplication_2)  # -> Geometry, Transform
move_2 = Move(Geometry=end_points.Start, Motion=multiplication)  # -> Geometry, Transform
line_2 = Line(StartPoint=end_points.Start, EndPoint=move_2.Geometry)
line_3 = Line(StartPoint=end_points_2.Start, EndPoint=move.Geometry)
join_curves = JoinCurves(Curves=flatten([line, line_2, line_3, offset_curve, offset_curve_2]), Preserve=False)
offset_curve_3 = OffsetCurve(Curve=join_curves, Plane=PlaneXY(0, 0, 0), Distance=Slider(1.5, range=0..2), BothSides=0, Kinks=0, CapType=1)
boundary_surfaces = BoundarySurfaces(Edges=offset_curve_3)
unit_z = UnitZ(Factor="0.2")
extrude = Extrude(Base=boundary_surfaces, Direction=unit_z)
move_3 = Move(Geometry=extrude, Motion=unit_z)  # -> Geometry, Transform
custom_preview = CustomPreview(Geometry=move_3.Geometry, Material=ColourSwatch(SwatchColor=RGB(21, 255, 0)))

tabsix_2 = RemoteReceiver(tabsix)

# ----
# Getting the Endges of the loaded Image
# Can Tune the Overlap amount here
file_path_3 = RemoteReceiver(file_path_2)
file_path_4 = FilePath(file_path_3)
import_image = ImportImage(File=file_path_4)
edges_filter = EdgesFilter(Image=file_path_4, Mode=0)
image_to_bitmap = ImageToBitmap(Image=edges_filter)
custom_preview_2 = CustomPreview(
    Geometry=import_image,
    Material={diffuse=RGB(221, 160, 221), emission=RGB(66, 48, 66), shine=0.5, specular=RGB(255, 255, 255), transparency=0})
showimage_2 = RemoteReceiver(showimage)
panel_25 = Panel(image_to_bitmap)
hide_show_object_preview = HideShowObjectPreview(Visible=showimage_2, AllObjects_Object=custom_preview_2)
edgethreshold_2 = RemoteReceiver(edgethreshold)
trace_bitmap = TraceBitmap(Image=image_to_bitmap, Mode=0, Size=2, Error=0.2, Threshold=edgethreshold_2, Alpha=1)
offset_curve_4 = OffsetCurve(Curve=trace_bitmap, Plane=PlaneXY(0, 0, 0), Distance=Slider(2, range=0..2), BothSides=0, Kinks=0, CapType=1)

# ----
# Baking Surfaces to be Selected by the User's
# Getting the Frame of the Image
# Seperating the Outermost Image Contour
imagescalingfactor_2 = RemoteReceiver(imagescalingfactor)
scale = Scale(Geometry=offset_curve_4, Center=Point(0, 0, 0), Factor=imagescalingfactor_2)  # -> Geometry, Transform
split_list = SplitList(List=flatten(scale.Geometry), Index="1")  # -> ListA, ListB
list_length = ListLength(List=split_list.ListB)
larger_than = LargerThan(FirstNumber=list_length, SecondNumber="1")  # -> LargerThan, OrEqualTo
stream_filter = StreamFilter(Gate=larger_than.LargerThan, Stream0="0", Stream1="1")
split_list_2 = SplitList(List=flatten(split_list.ListB), Index=stream_filter)  # -> ListA, ListB
boundary_surfaces_2 = BoundarySurfaces(Edges=split_list_2.ListB)
bounding_box = BoundingBox(Content=split_list.ListA, Plane=PlaneXY(0, 0, 0))  # -> Box, Box_2
panel_26 = Panel(boundary_surfaces_2)
area = Area(Geometry=bounding_box.Box)  # -> Area, Centroid
scale_2 = Scale(Geometry=bounding_box.Box, Center=area.Centroid, Factor=1.1)  # -> Geometry, Transform
create_surfaces_2 = RemoteReceiver(create_surfaces)
bounding_surface = RemoteSender(scale_2.Geometry)
bake_geometry = BakeGeometry(Bake=create_surfaces_2, Geometry=boundary_surfaces_2, DeleteOldBakes=False, PreserveTrees=False)

# ----
# Kirigami Pattern Generation
# Trying to exclude the unwanted outer part
# Will enable when the create surface command is given once
bounding_surface_2 = RemoteReceiver(bounding_surface)
create_surfaces_3 = RemoteReceiver(create_surfaces)
ghpython_script_3 = GhPythonScript(trigger=create_surfaces_3)  # -> out, a
# ---------- ghpython_script_3: Python ----------
__author__ = "aid-lab"
__version__ = "2024.04.15"

import rhinoscriptsyntax as rs

def setup():
    global result
    result = True
    print("Came here")

if trigger==True:
    setup()

if "result" not in globals():
    a = False
else:
    a = True
# ---------- end ghpython_script_3 ----------
stream_gate = StreamGate(Stream=bounding_surface_2, Gate=ghpython_script_3.a)  # -> Target0, Target1
brep_edges = BrepEdges(Brep=stream_gate.Target1)  # -> Naked, Interior, NonManifold
dimensions = Dimensions(Surface=stream_gate.Target1)  # -> UDimension, VDimension
surface_points = SurfacePoints(Surface=stream_gate.Target1)  # -> Points, Weights, Greville, UCount, VCount
list_item = ListItem(List=surface_points.Points, Index="0", Wrap=True)
bounding_surface_outline = RemoteSender(brep_edges.Naked)
bounding_surface_width = RemoteSender(dimensions.UDimension)
bounding_surface_height = RemoteSender(dimensions.VDimension)
deconstruct = Deconstruct(Point=list_item)  # -> XComponent, YComponent, ZComponent
start_x_index = RemoteSender(deconstruct.XComponent)
start_y_index = RemoteSender(deconstruct.YComponent)
hex_distance_slider_3 = RemoteReceiver(hex_distance_slider)
hex_radius_slider_3 = RemoteReceiver(hex_radius_slider)
ghpython_script_4 = GhPythonScript(
    x=deconstruct.XComponent,
    y=deconstruct.YComponent,
    z=deconstruct.ZComponent,
    H=bounding_surface_height,
    W=bounding_surface_width,
    R=hex_radius_slider_3,
    S=hex_distance_slider_3,
    t=Slider(0.2, range=0..100))  # -> output, a
# ---------- ghpython_script_4: Python ----------
__author__ = "aid-lab"
__version__ = "2024.04.14"

import rhinoscriptsyntax as rs
import math

def hexagon(center, radius):
    points = []
    for i in range(6):
        angle = math.radians(60*i)
        x = center[0] + radius*math.cos(angle)
        y = center[1] + radius*math.sin(angle)
        z = center[2]
        points.append(rs.AddPoint(x,y,z))
    return rs.AddPolyline(points + [points[0]]) #closing the polyline
    
def star(center, radius, thickness, type = 0):
    points = []
    if type == 0:
        angles = [60, 180, 300]
    elif type == 1:
        angles = [0, 120, 240]
        
    for angle in angles:
        x = center[0] + radius*math.cos(math.radians(angle))
        y = center[1] + radius*math.sin(math.radians(angle))
        z = center[2]
        #first point
        p1_x = x + math.cos(math.radians(270+angle))*thickness/2
        p1_y = y + math.sin(math.radians(270+angle))*thickness/2
        points.append(rs.AddPoint(p1_x, p1_y, z))
        
        #second point
        p2_x = x + math.cos(math.radians(90+angle))*thickness/2
        p2_y = y + math.sin(math.radians(90+angle))*thickness/2
        points.append(rs.AddPoint(p2_x, p2_y, z))
        
        #third point
        p3_x = center[0] + math.cos(math.radians(angle+60))*thickness/math.sqrt(3)
        p3_y = center[1] + math.sin(math.radians(angle+60))*thickness/math.sqrt(3)
        points.append(rs.AddPoint(p3_x, p3_y, z))
#        points.append(rs.AddPoint(x, y, z))
        
    return rs.AddPolyline(points + [points[0]]) #closing the polyline
        
    
    
#def hexagonal_grid(origin, radius, spacing, height, width):
#    
#    hexagons = []
#    vertical_spacing = (math.cos(math.radians(30))*radius)*2 + spacing
#    horizontal_spacing = vertical_spacing*math.cos(math.radians(30))
#    
#    #Calculating the number of rows and columns
#    rows = int(height//vertical_spacing + 1)
#    cols = int(width//horizontal_spacing + 1)
#    
#    for row in range(rows):
#        for col in range(cols):
#            x_offset = col*horizontal_spacing
#            y_offset = row*vertical_spacing
#            if col % 2 == 1:
#                y_offset += vertical_spacing*0.5 
#            center = (origin[0] + x_offset, origin[1] + y_offset, origin[2])
#            hexagons.append(hexagon(center, radius))
#    return hexagons

def kirigami_pattern(origin, radius, spacing, height, width, connector_thickness):
    
    hexagons = []
    stars = []
    vertical_spacing = (math.cos(math.radians(30))*radius)*2 + spacing
    horizontal_spacing = vertical_spacing*math.cos(math.radians(30))
    
    #Calculating the number of rows and columns
    rows = int(height//vertical_spacing + 1)
    cols = int(width//horizontal_spacing + 1)
    
    for row in range(rows):
        for col in range(cols):
            x_offset = col*horizontal_spacing
            y_offset = row*vertical_spacing
            if col % 2 == 1:
                y_offset += vertical_spacing*0.5 
            center = (origin[0] + x_offset, origin[1] + y_offset, origin[2])
            hexagons.append(hexagon(center, radius))
            
            #generating the stars
            t = connector_thickness
            r = 1.1*(spacing + t/2)/math.sqrt(3)
            center_1 = (center[0] + (radius+spacing/math.sqrt(3)), center[1], center[2])
            stars.append(star(center_1, r, t, 0))
            
            center_2 = (center[0] + math.cos(math.radians(60))*(radius+spacing/math.sqrt(3)), center[1] + math.sin(math.radians(60))*(radius+spacing/math.sqrt(3)), center[2])
            stars.append(star(center_2, r, t, 1))
            
    return hexagons + stars

#origin = (0, 0, 0)
origin = (x, y, z)
#print(origin[0])
a = kirigami_pattern(origin, R, S, H, W, t)

#a = star(origin, R, 0.3, 0)
# ---------- end ghpython_script_4 ----------
curve = Curve(ghpython_script_4.a)
region_union = RegionUnion(Curves=flatten(curve))
surface_sel_2 = RemoteReceiver(surface_sel)
boundary_surfaces_3 = BoundarySurfaces(Edges=region_union)
brep = Brep(surface_sel_2)
surface_split = SurfaceSplit(Surface=boundary_surfaces_3, Curves=flatten(brep))  # -> flatten(Fragments)
single_layer_thickness = Panel("0.2")
split_list_3 = SplitList(List=flatten(surface_split), Index="1")  # -> ListA, ListB
unit_z_2 = UnitZ(Factor=single_layer_thickness)
brep_2 = Brep(split_list_3.ListB)
extrude_2 = Extrude(Base=brep_2, Direction=unit_z_2)
move_4 = Move(Geometry=extrude_2, Motion=unit_z_2)  # -> Geometry, Transform
brep_3 = Brep(extrude_2)
brep_4 = Brep(move_4.Geometry)
selected_patterned = RemoteSender([brep_3, brep_4])

# ----
# Exporting the Stretch Sensor Files
base_path = Panel("../Outputs/StretchSensor")
base_path_2 = Panel("stretchEEL")
base_path_3 = Panel("stretchNinjaFlex")
ghpython_script_5 = GhPythonScript(segment_names=base_path_2, base_path=base_path)  # -> out, graft(a)
# ---------- ghpython_script_5: Python ----------
__author__ = "supun"
__version__ = "2023.04.30"

import rhinoscriptsyntax as rs

a = base_path + "/eel/" + segment_names + ".stl"
# ---------- end ghpython_script_5 ----------
ghpython_script_6 = GhPythonScript(segment_names=base_path_3, base_path=base_path)  # -> out, graft(a)
# ---------- ghpython_script_6: Python ----------
__author__ = "supun"
__version__ = "2023.04.30"

import rhinoscriptsyntax as rs

a = base_path + "/ninjaflex/" + segment_names + ".stl"
# ---------- end ghpython_script_6 ----------
panel_27 = Panel(ghpython_script_6.a)
panel_28 = Panel(ghpython_script_5.a)
export_3 = RemoteReceiver(export)
export_4 = RemoteReceiver(export)
ghpython_script_7 = GhPythonScript(brepTree=move_3.Geometry, fileName=ghpython_script_5.a, trigger=export_3)  # -> out, result; inputs brepTree: Brep
# ---------- ghpython_script_7: Python ----------
__author__ = "aid-lab"
__version__ = "2024.04.16"

import Rhino
import rhinoscriptsyntax as rs
import scriptcontext as sc
import System

def bakeAndSave(brep, fileName):
     # Prepare the Rhino document
    doc = sc.doc
    sc.doc = Rhino.RhinoDoc.ActiveDoc  # Ensure we're using the active Rhino document
    
    # Adding the BRep to the Rhino document
    if brep:
        id = sc.doc.Objects.AddBrep(brep)
        # Optional: Apply transformations, materials, etc.

    # Ensure the filename has the correct path and extension
#    filePath = System.IO.Path.ChangeExtension(fileName)
   
    # Select the objects for export
    rs.SelectObjects(id)
    
    # Save the selected objects to a file
    rs.Command("_-Export " + chr(34) + fileName + chr(34) + " _Enter _Enter", False)
#    rs.Command("_-Export " + chr(34) + fileName, False)

    sc.doc.Objects.Delete(id, True)#Comment this out if craqshing occurs
    # Deselect objects after saving
    rs.UnselectAllObjects()
    
    # Clean up and return RhinoDoc to Grasshopper
    sc.doc = doc
    
    return fileName  # Return the list of filenames for confirmation or further use

if trigger:
    result = bakeAndSave(brepTree, fileName)
# ---------- end ghpython_script_7 ----------
ghpython_script_8 = GhPythonScript(brepTree=extrude, fileName=ghpython_script_6.a, trigger=export_4)  # -> out, result; inputs brepTree: Brep
# ---------- ghpython_script_8: Python ----------
__author__ = "aid-lab"
__version__ = "2024.04.16"

import Rhino
import rhinoscriptsyntax as rs
import scriptcontext as sc
import System

def bakeAndSave(brep, fileName):
     # Prepare the Rhino document
    doc = sc.doc
    sc.doc = Rhino.RhinoDoc.ActiveDoc  # Ensure we're using the active Rhino document
    
    # Adding the BRep to the Rhino document
    if brep:
        id = sc.doc.Objects.AddBrep(brep)
        # Optional: Apply transformations, materials, etc.

    # Ensure the filename has the correct path and extension
#    filePath = System.IO.Path.ChangeExtension(fileName)
    
    # Select the objects for export
    rs.SelectObjects(id)
    
    # Save the selected objects to a file
    rs.Command("_-Export " + chr(34) + fileName + chr(34) + " _Enter _Enter", False)
#    rs.Command("_-Export " + chr(34) + fileName, False)

    sc.doc.Objects.Delete(id, True)#Comment this out if craqshing occurs
    # Deselect objects after saving
    rs.UnselectAllObjects()
    
    # Clean up and return RhinoDoc to Grasshopper
    sc.doc = doc
    
    return fileName  # Return the list of filenames for confirmation or further use

if trigger:
    result = bakeAndSave(brepTree, fileName)
# ---------- end ghpython_script_8 ----------

# ---- group: Export to STL
# This example demonstrates how to use the "True Button",
#  "Export to STL" and "Filepath series" components from Pancake.
# Example Box
box = CenterBox(Base=PlaneXY(0, 0, 0), X=1, Y=1, Z=1)  # disabled
mesh = Mesh(box)  # disabled

# Multiple target files, multiple by multiple (Meshes are exported to multple files. In the example, ten would be generated after another ten)
panel_29 = Panel("10")  # disabled
panel_30 = Panel("D:\STLExport{0}.stl")  # disabled
mesh_2 = Mesh(mesh)  # disabled
truebutton = TrueOnlyButton()  # disabled
dup = DuplicateData(Data=mesh_2, Number=panel_29, Order=True)  # disabled
pcfileseries = FilepathSeries(PatternOfFilepath=panel_30, StartingIndex=1, QuantityOfFilenames=panel_29, GenerateNext=truebutton, Reset=False)  # -> Filepath, ListOfFilepath, CounterOfFirstFile; disabled
pcexportstl = ExportSTL(Mesh=dup, Relocate=True, SavePath=pcfileseries.ListOfFilepath, SaveAsBinaryFile=True, SaveNow=truebutton)  # disabled
panel_31 = Panel(pcfileseries.ListOfFilepath)  # disabled
panel_32 = Panel(pcexportstl)  # disabled

# Multiple target files, at once (Meshes are exported to multple fixed files, all at once)
panel_33 = Panel("10")  # disabled
panel_34 = Panel("""D:\STLExport1.stl
D:\STLExport2.stl
D:\STLExport3.stl
D:\STLExport4.stl
D:\STLExport5.stl
D:\STLExport6.stl
D:\STLExport7.stl
D:\STLExport8.stl
D:\STLExport9.stl
D:\STLExport10.stl""")  # disabled
mesh_3 = Mesh(mesh)  # disabled
dup_2 = DuplicateData(Data=mesh_3, Number=panel_33, Order=True)  # disabled
truebutton_2 = TrueOnlyButton()  # disabled
pcexportstl_2 = ExportSTL(Mesh=dup_2, Relocate=True, SavePath=panel_34, SaveAsBinaryFile=True, SaveNow=truebutton_2)  # disabled
panel_35 = Panel(pcexportstl_2)  # disabled

# ----
relative_path = RelativePath(Path="..\Flow\filements.txt")

# ---- group: Export to STL
# One target file. (Mesh is exported to one fixed file. Overwrite if it already exists.)
panel_36 = Panel("C:\Users\aid-lab\OneDrive - The University of Sydney (Students)\2_Projects\5_IrOnTex\ToolKit-CHI-WithReadMe\ToolKit - CHI\Outputs\Boundaries\test.stl")  # disabled
mesh_4 = Mesh(mesh)  # disabled
truebutton_3 = TrueOnlyButton()  # disabled
pcexportstl_3 = ExportSTL(Mesh=mesh_4, Relocate=True, SavePath=panel_36, SaveAsBinaryFile=True, SaveNow=truebutton_3)  # disabled
panel_37 = Panel(pcexportstl_3)  # disabled

# Multiple target files, one-by-one. (Meshes are exported to multiple files, and one after another.)
mesh_5 = Mesh(mesh)  # disabled
panel_38 = Panel("D:\STLExport{0}.stl")  # disabled
truebutton_4 = TrueOnlyButton()  # disabled
pcfileseries_2 = FilepathSeries(PatternOfFilepath=panel_38, StartingIndex=1, QuantityOfFilenames=-1, GenerateNext=truebutton_4, Reset=False)  # -> Filepath, ListOfFilepath, CounterOfFirstFile; disabled
pcexportstl_4 = ExportSTL(Mesh=mesh_5, Relocate=True, SavePath=pcfileseries_2.Filepath, SaveAsBinaryFile=True, SaveNow=truebutton_4)  # disabled
panel_39 = Panel(pcfileseries_2.Filepath)  # disabled
panel_40 = Panel(pcexportstl_4)  # disabled

# ----
file_path_5 = FilePath(relative_path)
read_file = ReadFile(File=file_path_5, PerLineParse=True)
panel_41 = Panel(read_file)
removelastfilament_2 = RemoteReceiver(removelastfilament)
commitcommand_2 = RemoteReceiver(commitcommand)
commitmessage_2 = RemoteReceiver(commitmessage)
panel_42 = Panel("""False
True""")
ghpython_script_9 = GhPythonScript(Default=panel_41, commit=commitmessage_2, addFilament=commitcommand_2, filepath=file_path_5, remove=removelastfilament_2)  # -> out, lis, wt; inputs Default: list, addFilament: Boolean, remove: Boolean
# ---------- ghpython_script_9: Python ----------
print(commit)
lis= Default

if addFilament:
    lis.append(commit)
    f = open(filepath, "w")
#    f.write(Default)
    for item in lis:
        f.writelines(item+"\n")
    f.close()

#lis = Default
if remove:
    lis.pop(-1)
    f = open(filepath, "w")
#    f.write(Default)
    for item in lis:
        f.writelines(item+"\n")
    f.close()
print(Default)
# ---------- end ghpython_script_9 ----------
ghpython_script_10 = GhPythonScript(x=ghpython_script_9.lis, y="20")  # -> out, a
# ---------- ghpython_script_10: Python ----------
__author__ = "supun"
__version__ = "2023.05.12"

import rhinoscriptsyntax as rs

a = x + " " * int(y)
# ---------- end ghpython_script_10 ----------
panel_43 = Panel(ghpython_script_9.lis)
panel_44 = Panel(ghpython_script_9.lis)
list_length_2 = ListLength(List=ghpython_script_10.a)
integer_division = IntegerDivision(A=list_length_2, B="6")
addition = Addition(A=integer_division, B="1")
partition_list = PartitionList(List=ghpython_script_10.a, Size=addition)
create_radio_button = CreateRadioButton(RadioButtonName=partition_list, RadioButtonGroup="Group 1", InitiallySelected=panel_42)
value_listener_18 = ValueListener(Elements=flatten(create_radio_button), SomeProperty=True)  # -> flatten(Values), Indices
radio_filement = RemoteSender(create_radio_button)
panel_45 = Panel(create_radio_button)
panel_46 = Panel(value_listener_18.Values)
member_index = MemberIndex(Set=panel_46, Member="True")  # -> Index, Count
panel_47 = Panel(partition_list)
selected_patterned_2 = RemoteReceiver(selected_patterned)
panel_48 = Panel(member_index.Index)
event_gate = EventGate(Data=panel_48)  # -> Data, IsNew
event_gate_2 = EventGate(Data=selected_patterned_2)  # -> Data, IsNew
reset_3 = RemoteReceiver(reset)
ghpython_script_11 = GhPythonScript(ind=event_gate.Data, lis=event_gate_2.Data, reset=reset_3)  # -> out, graft(mesharr), clarr; inputs ind: Int32, lis: list of Brep
# ---------- ghpython_script_11: Python ----------
import rhinoscriptsyntax as rs

def setup():
    global ind_array
    global brep_arr
#    global discarding_brep
    
#    discarding_brep = True
    ind_array = []
    brep_arr = []

if reset==True or "ind_array" not in globals():
    setup()
else:
    for brep in lis:
        #Check whether they are there before appending
#        print(brep in brep_arr)
        if brep!=None and brep not in brep_arr:
#            print(brep in brep_arr)
            ind_array.append(ind)
            brep_arr.append(brep)
    mesharr = brep_arr
    clarr = ind_array
# ---------- end ghpython_script_11 ----------
panel_49 = Panel("""0,0,0
0,255,0
255,0,0
0,0,255
255,255,255
255,0,255
0,255,255
240,197,7
184,245,235
64,33,1
0,0,125
125,125,0
125,0,125
0,125,125
255,125,125
125,255,125
125,125,255
0,125,255
0,255,125
125,255,0
125,0,255
255,0,125
255,125,0""")
flatten_tree = FlattenTree(Tree=ghpython_script_11.mesharr, Path="{0}")
panel_50 = Panel(ghpython_script_11.mesharr)
panel_51 = Panel(ghpython_script_11.clarr)
panel_52 = Panel(ghpython_script_11.out)
ghpython_script_12 = GhPythonScript(x=panel_44, basePath="..\Outputs")  # -> out, graft(a); inputs x: list
# ---------- ghpython_script_12: Python ----------
u=[]
i = 1
for name in x:
    u.append(basePath+"\\"+str(i)+"_"+name+".STL")
    i+=1
print(u)
a=u
# ---------- end ghpython_script_12 ----------
ghpython_script_13 = GhPythonScript(meshlis=flatten_tree, indlis=ghpython_script_11.clarr, fillis=panel_44)  # -> out, arr; inputs meshlis: list, indlis: list of Int32, fillis: list
# ---------- ghpython_script_13: Python ----------
#meshlis
#indlis
#fillis
import ghpythonlib.treehelpers as th
#import Rhino

leng = len(fillis)
arr = []

for _ in range(leng):
    arr.append([])
for i,ind in enumerate(indlis):
    arr[ind].append(meshlis[i])
    print(ind,meshlis[i])
print(arr)

arr = th.list_to_tree(arr, source=[0,0])
# ---------- end ghpython_script_13 ----------
list_item_2 = ListItem(List=panel_49, Index=ghpython_script_11.clarr, Wrap=True)  # -> graft(Item)
panel_53 = Panel(flatten_tree)
ghpython_script_14 = GhPythonScript(x=list_item_2)  # -> out, r, g, b
# ---------- ghpython_script_14: Python ----------
l=x.split(",")
print(l)
r =int(l[0])
g=int(l[1])
b=int(l[2])
# ---------- end ghpython_script_14 ----------
panel_54 = Panel(ghpython_script_12.a)
panel_55 = Panel(ghpython_script_13.arr)
colour_rgb = ColourRGB(Alpha=255, Red=ghpython_script_14.r, Green=ghpython_script_14.g, Blue=ghpython_script_14.b)
export_5 = RemoteReceiver(export)
custom_preview_3 = CustomPreview(Geometry=ghpython_script_11.mesharr, Material=colour_rgb)
panel_56 = Panel(colour_rgb)
ghpython_script_15 = GhPythonScript(brepTree=ghpython_script_13.arr, fileNames=ghpython_script_12.a, trigger=export_5)  # -> out, result; inputs brepTree: tree of Brep, fileNames: tree
# ---------- ghpython_script_15: Python ----------
__author__ = "aid-lab"
__version__ = "2024.04.17"

import Rhino
import rhinoscriptsyntax as rs
import scriptcontext as sc
import System

def BakeAndSave(brepTree, fileNames):
#    if len(brepTree) != len(fileNames):
#        raise ValueError("The number of BReps must match the number of filenames provided.")

    # Prepare the Rhino document
    doc = sc.doc
    sc.doc = Rhino.RhinoDoc.ActiveDoc  # Ensure we're using the active Rhino document

    for i in range(brepTree.BranchCount):
        # Bake each BRep in the Rhino document
        ids = []
        for n in range(brepTree.Branches[i].Count):
            brep = brepTree.Branches[i][n]
            if brep:
                # Adding the BRep to the Rhino document
                id = sc.doc.Objects.AddBrep(brep)
                ids.append(id)
                # Optional: Apply transformations, materials, etc.
                
        # Select the objects for export
        rs.SelectObjects(ids)

        # Save the selected objects to a file
        rs.Command("_-Export " + chr(34) + fileNames.Branches[i][0] + chr(34) + " _Enter _Enter", False)
        
        sc.doc.Objects.Delete(ids, True)#Comment this out if craqshing occurs
        # Deselect objects after saving
        rs.UnselectAllObjects()

    # Clean up and return RhinoDoc to Grasshopper
    sc.doc = doc

    return fileNames  # Return the list of filenames for confirmation or further use

# Example usage:
#brepTree = []  # Replace this with the actual input tree of BReps from Grasshopper
#fileNames = []  # Replace this with the actual list of filenames from Grasshopper
if trigger:
    result = BakeAndSave(brepTree, fileNames)
# ---------- end ghpython_script_15 ----------

# ----
# Setting Point Button
panel_57 = Panel("Start Setting Points")
buttonbgcolor_7 = RemoteReceiver(buttonbgcolor)
gridbgcolor_16 = RemoteReceiver(gridbgcolor)

# ----
# 2_Filament Selection Tab
# Show Hide Patterning Preview
panel_58 = Panel("")
create_label_9 = CreateLabel(LabelText="Preview Pattern", LabelSize=12, Justification=0)
create_toggle_2 = CreateToggle(Default="True", Label=panel_58, OnLabel="Show", OffLabel="Hide")
value_listener_19 = ValueListener(Elements=create_toggle_2, SomeProperty=True)  # -> Values, Indices
set_label_contents_9 = SetLabelContents(LabelToModify=create_label_9, NewLabelContents="Preview Pattern")
adjust_element_positioning_38 = AdjustElementPositioning(
    ElementsToAdjust=create_toggle_2,
    Margin="40,0,0,20",
    AbsolutePositioning=True,
    HorizontalAlignment=0,
    VerticalAlignment=2)
adjust_element_positioning_39 = AdjustElementPositioning(ElementsToAdjust=create_label_9, Margin="150,30,0,20", AbsolutePositioning=False, HorizontalAlignment=0)
adjust_element_appearance_34 = AdjustElementAppearance(ElementsToAdjust=create_label_9, FontSize="12")
panel_59 = Panel(value_listener_19.Values)
merge_2 = Merge(Data1=create_toggle_2, Data2=create_label_9)
create_grid_3 = CreateGrid(UIElements=merge_2, ElementRowSpan=1, ElementColumnSpan=1)
gridbgcolor_17 = RemoteReceiver(gridbgcolor)
adjust_element_appearance_35 = AdjustElementAppearance(ElementsToAdjust=create_grid_3, Background=gridbgcolor_17)
preview_toggle = RemoteSender(create_grid_3)
showpatternpreview = RemoteSender(value_listener_19.Values)
radio_filement_2 = RemoteReceiver(radio_filement)
boolean = Boolean(True)
create_stack = CreateStack(UIElements=radio_filement_2, Horizontal=boolean)
preview_toggle_2 = RemoteReceiver(preview_toggle)
label_rough_2 = RemoteReceiver(label_rough)
reset_4 = RemoteReceiver(reset_2)
selsuf_2 = RemoteReceiver(selsuf)
winwidth_12 = RemoteReceiver(winwidth)
gridbgcolor_18 = RemoteReceiver(gridbgcolor)

showpatternpreview_2 = RemoteReceiver(showpatternpreview)
hide_show_object_preview_2 = HideShowObjectPreview(Visible=showpatternpreview_2, AllObjects_Object=custom_preview_3)

# ----
# Edit Filament List Trigger
panel_60 = Panel("Edit Filament List")
create_button_7 = CreateButton(ButtonName=panel_60, ButtonStyle=0)
adjust_element_appearance_36 = AdjustElementAppearance(ElementsToAdjust=create_button_7, Background=ColourSwatch(SwatchColor=RGB(154, 214, 130)))
value_listener_20 = ValueListener(Elements=create_button_7, SomeProperty=True)  # -> Values, Indices
adjust_element_positioning_40 = AdjustElementPositioning(
    ElementsToAdjust=create_button_7,
    Margin="0,-10,0,20",
    AbsolutePositioning=False,
    Width=Slider(215, range=0..1000),
    HorizontalAlignment=0)
set_button_5 = SetButton(ButtonToModify=create_button_7)
create_simple_grid_19 = CreateSimpleGrid(UIElements=create_button_7, RowDefinitions="Auto", ColumnDefinitions="Auto")
gridbgcolor_19 = RemoteReceiver(gridbgcolor)
adjust_element_positioning_41 = AdjustElementPositioning(ElementsToAdjust=create_simple_grid_19, Margin="330,-50,0,0", AbsolutePositioning=False)
adjust_element_appearance_37 = AdjustElementAppearance(ElementsToAdjust=create_simple_grid_19, Background=gridbgcolor_19)
edit_filament_list = RemoteSender(create_simple_grid_19)

event_toggle = EventToggle(Boolean=value_listener_20.Values)
showpopupwindow = RemoteSender(event_toggle)

panel_61 = Panel(event_toggle)

edit_filament_list_2 = RemoteReceiver(edit_filament_list)
entwine_6 = Entwine(
    Branch00=label_rough_2,
    Branch02=selsuf_2,
    Branch03=reset_4,
    Branch04=create_stack,
    Branch05=preview_toggle_2,
    Branch06=edit_filament_list_2,
    FlattenInputs=True)
create_simple_grid_20 = CreateSimpleGrid(UIElements=flatten(entwine_6), Width=winwidth_12, RowDefinitions="Auto", ColumnDefinitions="Auto")
adjust_element_positioning_42 = AdjustElementPositioning(ElementsToAdjust=create_simple_grid_20, Margin="0,10,0,0", AbsolutePositioning=False, HorizontalAlignment=1)
adjust_element_appearance_38 = AdjustElementAppearance(ElementsToAdjust=create_simple_grid_20, Background=gridbgcolor_18)
tabtwo = RemoteSender(create_simple_grid_20)

# ----
# 5_Conductive Boundary Selection
create_button_8 = CreateButton(ButtonName=panel_57, ButtonStyle=0)
selectedsurface = RemoteSender(value_listener_10.Values)
winwidth_13 = RemoteReceiver(winwidth)
gridbgcolor_20 = RemoteReceiver(gridbgcolor)

adjust_element_positioning_43 = AdjustElementPositioning(
    ElementsToAdjust=create_button_8,
    Margin="0,0,0,20",
    AbsolutePositioning=False,
    Width=Slider(150, range=0..1000),
    HorizontalAlignment=0)
value_listener_21 = ValueListener(Elements=create_button_8, SomeProperty=True)  # -> Values, Indices
adjust_element_appearance_39 = AdjustElementAppearance(ElementsToAdjust=create_button_8, Background=buttonbgcolor_7)
create_simple_grid_21 = CreateSimpleGrid(UIElements=create_button_8, RowDefinitions="Auto", ColumnDefinitions="Auto")
panel_62 = Panel(value_listener_21.Values)
startsettingpoints = RemoteSender(value_listener_21.Values)
adjust_element_appearance_40 = AdjustElementAppearance(ElementsToAdjust=create_simple_grid_21, Background=gridbgcolor_16)
stretch_sensor_set_line_2 = RemoteSender(create_simple_grid_21)
adjust_element_positioning_44 = AdjustElementPositioning(ElementsToAdjust=create_simple_grid_21, Margin="225,-49,0,0", AbsolutePositioning=False)

# ----
# Creating the Conductive Line Segments
# Reference Commands
# Command: ( ShowDialog=Yes  SetAll  Curves=No  Surfaces=No  Polysurfaces=Yes  SubDs=Yes  Meshes=Yes  Annotations=Yes  Lights=Yes  Blocks=Yes  Points=Yes  ControlPoints=Yes  PointClouds=Yes  Hatches=Yes  Others=Yes  DisableFilter=No  Subobjects=No )
command_2 = Panel("""_-SelectionFilter _ShowDialog=Yes _Curves=No _Surfaces=No _Points=Yes _Curves=No _Enter
_Points""")
command_3 = Panel("_-SelectionFilter _ShowDialog=Yes _Curves=No _Surfaces=No _Points=Yes _Curves=No _Enter")
selectedsurface_2 = RemoteReceiver(selectedsurface)
selectsetpoints_2 = RemoteReceiver(selectsetpoints)
startsettingpoints_2 = RemoteReceiver(startsettingpoints)
rhino_command_2 = RhinoCommand(SendCommandToggle=startsettingpoints_2, CommandString=command_2)
rhino_command_3 = RhinoCommand(SendCommandToggle=selectsetpoints_2, CommandString=command_3)
point = Point(selectsetpoints_2)
brep_edges_2 = BrepEdges(Brep=selectedsurface_2)  # -> Naked, Interior, NonManifold
join_curves_2 = JoinCurves(Curves=brep_edges_2.Naked, Preserve=False)
curve_closest_point = CurveClosestPoint(Point=flatten(point), Curve=flatten(join_curves_2))  # -> Point, Parameter, Distance
shatter = Shatter(Curve=join_curves_2, Parameters=curve_closest_point.Parameter)
panel_63 = Panel(shatter)
line_segments = RemoteSender(shatter)

# ----
# Segment Selection Drop Down
line_segments_2 = RemoteReceiver(line_segments)
list_length_3 = ListLength(List=line_segments_2)
ghpython_script_16 = GhPythonScript(x=list_length_3)  # -> out, a
# ---------- ghpython_script_16: Python ----------
__author__ = "supun"
__version__ = "2023.04.28"

import rhinoscriptsyntax as rs

a = []

for i in range(x):
    temp = "Segment " + str(i+1)
    a.append(temp)
# ---------- end ghpython_script_16 ----------
create_checklist = CreateChecklist(ChecklistItems=ghpython_script_16.a, Selected=False)
create_expander = CreateExpander(UIElements=create_checklist, Open=True)
value_listener_22 = ValueListener(Elements=create_checklist, SomeProperty=True)  # -> Values, Indices
panel_64 = Panel(value_listener_22.Values)
line_segment_selection_expander = RemoteSender(create_expander)
boolean_2 = Boolean(True)
member_index_2 = MemberIndex(Set=value_listener_22.Values, Member=boolean_2)  # -> Index, Count
panel_65 = Panel(member_index_2.Index)
list_item_3 = ListItem(List=line_segments_2, Index=panel_65, Wrap=True)
selected_line_segments = RemoteSender(list_item_3)
list_item_4 = ListItem(List=ghpython_script_16.a, Index=panel_65, Wrap=True)
conductivesegmentnames = RemoteSender(list_item_4)

line_segment_selection_expander_2 = RemoteReceiver(line_segment_selection_expander)
entwine_7 = Entwine(
    Branch00=stretch_sensor_label_2,
    Branch01=stretch_sensor_select_surface,
    Branch02=stretch_sensor_set_line_2,
    Branch03=create_simple_grid_11,
    Branch04=line_segment_selection_expander_2,
    FlattenInputs=True)
create_simple_grid_22 = CreateSimpleGrid(UIElements=flatten(entwine_7), Width=winwidth_13, RowDefinitions="Auto", ColumnDefinitions="Auto")
panel_66 = Panel(entwine_7)
adjust_element_positioning_45 = AdjustElementPositioning(ElementsToAdjust=create_simple_grid_22, Margin="0,10,0,0", AbsolutePositioning=False, HorizontalAlignment=1)
adjust_element_appearance_41 = AdjustElementAppearance(ElementsToAdjust=create_simple_grid_22, Background=gridbgcolor_20)
tabfive = RemoteSender(create_simple_grid_22)

selected_line_segments_2 = RemoteReceiver(selected_line_segments)

# ----
# Generating the EEL-Ninjaflex Traces
panel_67 = Panel("0.5")
offset_curve_5 = OffsetCurve(Curve=selected_line_segments_2, Distance=panel_67, Corners=1)
offset_curve_6 = OffsetCurve(Curve=selected_line_segments_2, Distance="-0.5", Corners=1)
end_points_3 = EndPoints(Curve=offset_curve_6)  # -> Start, End
curve_closest_point_2 = CurveClosestPoint(Point=end_points_3.End, Curve=offset_curve_5)  # -> Point, Parameter, Distance
curve_closest_point_3 = CurveClosestPoint(Point=end_points_3.Start, Curve=offset_curve_5)  # -> Point, Parameter, Distance
line_4 = Line(StartPoint=end_points_3.End, EndPoint=curve_closest_point_2.Point)
line_5 = Line(StartPoint=end_points_3.Start, EndPoint=curve_closest_point_3.Point)
merge_3 = Merge(Data1=offset_curve_6, Data2=line_5, Data3=offset_curve_5, Data4=line_4)
boundary_surfaces_4 = BoundarySurfaces(Edges=merge_3)
layer_thickness = Panel("0.2")
unit_z_3 = UnitZ(Factor=layer_thickness)
extrude_3 = Extrude(Base=boundary_surfaces_4, Direction=unit_z_3)
move_5 = Move(Geometry=extrude_3, Motion=unit_z_3)  # -> Geometry, Transform
custom_preview_4 = CustomPreview(Geometry=extrude_3, Material=ColourSwatch(SwatchColor=RGB(21, 255, 0)))
custom_preview_5 = CustomPreview(Geometry=move_5.Geometry, Material=ColourSwatch(SwatchColor=RGB(0, 0, 0)))
ninjaflex_layer = RemoteSender(extrude_3)
eel_layer = RemoteSender(move_5.Geometry)

tabfive_2 = RemoteReceiver(tabfive)

accent_colors = ValueList({"Amber", "Blue", "Brown", "Cobalt", "Crimson", "Cyan", "Emerald", "Green", "Indigo", "Lime", "Magenta", "Mauve", "Olive", "Orange", "Pink", "Purple", "Red", "Sienna", "Steel", "Taupe", "Teal", "Violet", "Yellow"}, selected="Green")
tabtwo_2 = RemoteReceiver(tabtwo)
winheight_2 = RemoteReceiver(winheight)
tabone_2 = RemoteReceiver(tabone)
tabthree_2 = RemoteReceiver(tabthree)
winwidth_14 = RemoteReceiver(winwidth)
tabfour_2 = RemoteReceiver(tabfour)
# MAIN Tool Interface
panel_68 = Panel(accent_colors)
entwine_8 = Entwine(
    Branch00=tabone_2,
    Branch01=tabthree_2,
    Branch02=tabtwo_2,
    Branch03=tabfour_2,
    Branch04=tabfive_2,
    Branch05=tabsix_2,
    FlattenInputs=True)  # -> flatten(Result)
accentcolour = RemoteSender(accent_colors)
launch_transparent_window = LaunchTransparentWindow(
    Show=Toggle(True),
    Name="Iron-On-Tex Toolkit",
    Width=winwidth_14,
    Height=winheight_2,
    ChildStatus=1,
    EnableHorizScroll=False)
create_simple_grid_23 = CreateSimpleGrid(UIElements=entwine_8, RowDefinitions="Auto", ColumnDefinitions="Auto")
winbgcolor_2 = RemoteReceiver(winbgcolor)
add_elements = AddElements(Window=launch_transparent_window, Elements=flatten(create_simple_grid_23), DoVLChecking=True)  # -> AddedElements, ElementNames
set_window_properties = SetWindowProperties(
    Window=launch_transparent_window,
    Theme=0,
    AccentColor=accent_colors,
    ShowTitleBar=True,
    BackgroundColor=winbgcolor_2,
    ScaleFactor=1)

# ----
# Edit Filament List Pop Up
number_slider = Slider(142, range=0..1000)
showpopupwindow_2 = RemoteReceiver(showpopupwindow)
launch_window = LaunchWindow(
    Show=showpopupwindow_2,
    Name="Edit Filament List",
    Width=370,
    Height=number_slider,
    ChildStatus=1,
    EnableHorizScroll=False)
accentcolour_2 = RemoteReceiver(accentcolour)
set_window_properties_2 = SetWindowProperties(
    Window=launch_window,
    Theme=0,
    AccentColor=accentcolour_2,
    ShowTitleBar=True,
    BackgroundColor=ColourSwatch(SwatchColor=RGB(255, 255, 255)),
    ScaleFactor=1)

# ----
# 2.1_Pop Up Window to Filament Edit List
commitfilamentbutton_2 = RemoteReceiver(commitfilamentbutton)
removefilamentbutton_2 = RemoteReceiver(removefilamentbutton)
filamentnamelabel_2 = RemoteReceiver(filamentnamelabel)
entwine_9 = Entwine(Branch00=filamentnamelabel_2, Branch01=commitfilamentbutton_2, Branch02=removefilamentbutton_2, FlattenInputs=True)
add_elements_2 = AddElements(Window=launch_window, Elements=flatten(entwine_9), DoVLChecking=True)  # -> AddedElements, ElementNames

# ----
# Exporting theConductive Traces
base_path_4 = Panel("../Outputs/Boundaries")
conductivesegmentnames_2 = RemoteReceiver(conductivesegmentnames)
ghpython_script_17 = GhPythonScript(segment_names=conductivesegmentnames_2, base_path=base_path_4)  # -> out, graft(a); same code as ghpython_script_5
ghpython_script_18 = GhPythonScript(segment_names=conductivesegmentnames_2, base_path=base_path_4)  # -> out, graft(a); same code as ghpython_script_6
panel_69 = Panel(ghpython_script_18.a)
panel_70 = Panel(ghpython_script_17.a)
ninjaflex_layer_2 = RemoteReceiver(ninjaflex_layer)
eel_layer_2 = RemoteReceiver(eel_layer)
export_6 = RemoteReceiver(export)
export_7 = RemoteReceiver(export)
ghpython_script_19 = GhPythonScript(brepTree=eel_layer_2, fileName=ghpython_script_17.a, trigger=export_6)  # -> out, result; inputs brepTree: Brep; same code as ghpython_script_8
ghpython_script_20 = GhPythonScript(brepTree=ninjaflex_layer_2, fileName=ghpython_script_18.a, trigger=export_7)  # -> out, result; inputs brepTree: Brep; same code as ghpython_script_8
